# Dynamo graph Sample.dyn (Dynamo 3.5.0.8297)
# packages: WombatDynamo 2.3.5, Synthesize toolkit 11.7.5

code_block = CodeBlock { 0; 750; 1500; }
byCoordinates = Point.ByCoordinates(x=code_block.out1, y=code_block.out2, z=code_block.out0)
byCoordinates_2 = Point.ByCoordinates(x=code_block.out2, y=code_block.out1, z=code_block.out2)
byStartPointEndPoint = Line.ByStartPointEndPoint(startPoint=byCoordinates, endPoint=byCoordinates_2)
vectorByCurve = Generate.Geometry.VectorByCurve(curve=byStartPointEndPoint)
select_the_single_door_in_the = DSModelElementSelection()  # "SELECT THE SINGLE DOOR IN THE HOST FILE"; 1 picked in the model
getAndUniteElementSolids = GeometryAPI.SolidsAPI.GetAndUniteElementSolids(element=select_the_single_door_in_the)
returnDynamoSolid = GeometryAPI.SolidsAPI.ReturnDynamoSolid(solid=getAndUniteElementSolids)
code_block_2 = CodeBlock { 255; }
byARGB = Color.ByARGB(red=code_block_2)
byGeometryColor = Modifiers.GeometryColor.ByGeometryColor(geometry=returnDynamoSolid, color=byARGB, lacing=Longest)
select_linked_elements = Python()  # CPython3
# ---------- select_linked_elements.python (52 lines) ----------
# CPython 3 version for Dynamo
import clr

# Add Revit API references
clr.AddReference("RevitAPIUI")
from Autodesk.Revit.UI import *

clr.AddReference("RevitAPI")
from Autodesk.Revit.DB import RevitLinkInstance

clr.AddReference("RevitServices")
import RevitServices
from RevitServices.Persistence import DocumentManager

# Get current document and UI document
doc = DocumentManager.Instance.CurrentDBDocument
uidoc = DocumentManager.Instance.CurrentUIApplication.ActiveUIDocument

clr.AddReference("RevitNodes")
import Revit
clr.ImportExtensions(Revit.Elements)
clr.ImportExtensions(Revit.GeometryConversion)

# Get selection object
sel1 = uidoc.Selection

# Define object types
ot1 = Selection.ObjectType.Element
ot2 = Selection.ObjectType.LinkedElement

TaskDialog.Show("Message", "Click on the link and select the single door")

# Pick link instance
li_ref = sel1.PickObject(ot1, "Select a link instance first! (or hit ESC)")
link1 = doc.GetElement(li_ref.ElementId)

if isinstance(link1, RevitLinkInstance):
    # Pick linked elements
    el_ref = sel1.PickObjects(ot2, "Select the linked elements and press Finish.")
    linkDoc = link1.GetLinkDocument()
    
    # Extract linked element IDs
    Lel_id = [r1.LinkedElementId for r1 in el_ref]
    
    # Get transformation
    tf1 = link1.GetTotalTransform().ToCoordinateSystem(True)
    
    # Convert elements to Dynamo types, keep link1 as raw Revit API object
    # Wrap link1 in a list to prevent automatic conversion
    OUT = [linkDoc.GetElement(id1).ToDSType(True) for id1 in Lel_id], tf1, [link1]
else:
    OUT = "Failed to pick a linked instance", None, [None]
# ----------------------------------------
code_block_3 = CodeBlock(a=select_linked_elements) { a[0][0]; }
al_get_documents = Custom[AL.Get Documents]()  # package Synthesize toolkit; Queries all linked Revit files and retrieves their Name, LinkInstance and Document properties.
code_block_4 = CodeBlock(a=al_get_documents.VARLinkInstance) { a[0]; }
getAndUniteElementSolidsTransformed = GeometryAPI.SolidsAPI.GetAndUniteElementSolidsTransformed(element=code_block_3, linkInstance=code_block_4)
flatten = List.Flatten(list=getAndUniteElementSolidsTransformed)
returnDynamoSolid_2 = GeometryAPI.SolidsAPI.ReturnDynamoSolid(solid=flatten)
byGeometryColor_2 = Modifiers.GeometryColor.ByGeometryColor(geometry=returnDynamoSolid_2, color=byARGB, lacing=Longest)
select_linked_elements_2 = Python()  # CPython3
# ---------- select_linked_elements_2.python (52 lines) ----------
# CPython 3 version for Dynamo
import clr

# Add Revit API references
clr.AddReference("RevitAPIUI")
from Autodesk.Revit.UI import *

clr.AddReference("RevitAPI")
from Autodesk.Revit.DB import RevitLinkInstance

clr.AddReference("RevitServices")
import RevitServices
from RevitServices.Persistence import DocumentManager

# Get current document and UI document
doc = DocumentManager.Instance.CurrentDBDocument
uidoc = DocumentManager.Instance.CurrentUIApplication.ActiveUIDocument

clr.AddReference("RevitNodes")
import Revit
clr.ImportExtensions(Revit.Elements)
clr.ImportExtensions(Revit.GeometryConversion)

# Get selection object
sel1 = uidoc.Selection

# Define object types
ot1 = Selection.ObjectType.Element
ot2 = Selection.ObjectType.LinkedElement

TaskDialog.Show("Message", "Click on the link and select the double door")

# Pick link instance
li_ref = sel1.PickObject(ot1, "Select a link instance first! (or hit ESC)")
link1 = doc.GetElement(li_ref.ElementId)

if isinstance(link1, RevitLinkInstance):
    # Pick linked elements
    el_ref = sel1.PickObjects(ot2, "Select the linked elements and press Finish.")
    linkDoc = link1.GetLinkDocument()
    
    # Extract linked element IDs
    Lel_id = [r1.LinkedElementId for r1 in el_ref]
    
    # Get transformation
    tf1 = link1.GetTotalTransform().ToCoordinateSystem(True)
    
    # Convert elements to Dynamo types, keep link1 as raw Revit API object
    # Wrap link1 in a list to prevent automatic conversion
    OUT = [linkDoc.GetElement(id1).ToDSType(True) for id1 in Lel_id], tf1, [link1]
else:
    OUT = "Failed to pick a linked instance", None, [None]
# ----------------------------------------
code_block_5 = CodeBlock(a=select_linked_elements_2) { a[0][0]; a[1]; a[2][0]; }
watch = Watch(code_block_5.out0)
orientation = WombatDynamo.FamilyInstance.Orientation(familyInstance=watch)
elementOrientedBboxSolidTransformed = GeometryAPI.SolidsAPI.ElementOrientedBboxSolidTransformed(element=watch, point=orientation.pt, degAngle=orientation.rotation, linkInstance=code_block_4)
returnDynamoSolid_3 = GeometryAPI.SolidsAPI.ReturnDynamoSolid(solid=elementOrientedBboxSolidTransformed)
code_block_6 = CodeBlock { 255; }
byARGB_2 = Color.ByARGB(green=code_block_6)
byGeometryColor_3 = Modifiers.GeometryColor.ByGeometryColor(geometry=returnDynamoSolid_3, color=byARGB_2, lacing=Longest)
select_the_double_door_in_the = DSModelElementSelection()  # "SELECT THE DOUBLE DOOR IN THE SAMPLE FILE"; 1 picked in the model
orientation_2 = WombatDynamo.FamilyInstance.Orientation(familyInstance=select_the_double_door_in_the)
elementOrientedBboxSolid = GeometryAPI.SolidsAPI.ElementOrientedBboxSolid(element=select_the_double_door_in_the, point=orientation_2.pt, degAngle=orientation_2.rotation)
returnDynamoSolid_4 = GeometryAPI.SolidsAPI.ReturnDynamoSolid(solid=elementOrientedBboxSolid)
byGeometryColor_4 = Modifiers.GeometryColor.ByGeometryColor(geometry=returnDynamoSolid_4, color=byARGB_2, lacing=Longest)
rectangleByMinMaxPoint = Generate.Geometry.RectangleByMinMaxPoint(minPoint=byCoordinates, maxPoint=byCoordinates_2)
code_block_7 = CodeBlock { 100; }
byARGB_3 = Color.ByARGB(alpha=code_block_7)
byGeometryColor_5 = Modifiers.GeometryColor.ByGeometryColor(geometry=rectangleByMinMaxPoint, color=byARGB_3, lacing=Longest)
select_the_wall_in_the_host_file = DSModelElementByCategorySelection("OST_Walls")  # 1 picked in the model
getWallSolid = GeometryAPI.SolidsAPI.GetWallSolid(hostModelWall=select_the_wall_in_the_host_file)
returnDynamoSolid_5 = GeometryAPI.SolidsAPI.ReturnDynamoSolid(solid=getWallSolid)
code_block_8 = CodeBlock { 255; }
byARGB_4 = Color.ByARGB(blue=code_block_8)
byGeometryColor_6 = Modifiers.GeometryColor.ByGeometryColor(geometry=returnDynamoSolid_5, color=byARGB_4, lacing=Longest)
select_linked_elements_3 = Python()  # CPython3
# ---------- select_linked_elements_3.python (52 lines) ----------
# CPython 3 version for Dynamo
import clr

# Add Revit API references
clr.AddReference("RevitAPIUI")
from Autodesk.Revit.UI import *

clr.AddReference("RevitAPI")
from Autodesk.Revit.DB import RevitLinkInstance

clr.AddReference("RevitServices")
import RevitServices
from RevitServices.Persistence import DocumentManager

# Get current document and UI document
doc = DocumentManager.Instance.CurrentDBDocument
uidoc = DocumentManager.Instance.CurrentUIApplication.ActiveUIDocument

clr.AddReference("RevitNodes")
import Revit
clr.ImportExtensions(Revit.Elements)
clr.ImportExtensions(Revit.GeometryConversion)

# Get selection object
sel1 = uidoc.Selection

# Define object types
ot1 = Selection.ObjectType.Element
ot2 = Selection.ObjectType.LinkedElement

TaskDialog.Show("Message", "Click on the link and select the wall")

# Pick link instance
li_ref = sel1.PickObject(ot1, "Select a link instance first! (or hit ESC)")
link1 = doc.GetElement(li_ref.ElementId)

if isinstance(link1, RevitLinkInstance):
    # Pick linked elements
    el_ref = sel1.PickObjects(ot2, "Select the linked elements and press Finish.")
    linkDoc = link1.GetLinkDocument()
    
    # Extract linked element IDs
    Lel_id = [r1.LinkedElementId for r1 in el_ref]
    
    # Get transformation
    tf1 = link1.GetTotalTransform().ToCoordinateSystem(True)
    
    # Convert elements to Dynamo types, keep link1 as raw Revit API object
    # Wrap link1 in a list to prevent automatic conversion
    OUT = [linkDoc.GetElement(id1).ToDSType(True) for id1 in Lel_id], tf1, [link1]
else:
    OUT = "Failed to pick a linked instance", None, [None]
# ----------------------------------------
code_block_9 = CodeBlock(a=select_linked_elements_3) { a[0][0]; }
getWallSolidTransformed = GeometryAPI.SolidsAPI.GetWallSolidTransformed(linkModelWall=code_block_9, linkInstance=code_block_4)
flatten_2 = List.Flatten(list=getWallSolidTransformed)
returnDynamoSolid_6 = GeometryAPI.SolidsAPI.ReturnDynamoSolid(solid=flatten_2)
byGeometryColor_7 = Modifiers.GeometryColor.ByGeometryColor(geometry=returnDynamoSolid_6, color=byARGB_4, lacing=Longest)
code_block_10 = CodeBlock { [600, 1200, 1800, 2400, 3000]; }
translateSolidVertically = GeometryAPI.SolidsAPI.TranslateSolidVertically(solid=flatten_2, translation=code_block_10, lacing=Longest)
returnSolidCentroid = GeometryAPI.SolidsAPI.ReturnSolidCentroid(solid=translateSolidVertically)
returnDynamoSolid_7 = GeometryAPI.SolidsAPI.ReturnDynamoSolid(solid=translateSolidVertically)
code_block_11 = CodeBlock { 50; }
byARGB_5 = Color.ByARGB(alpha=code_block_11)
byGeometryColor_8 = Modifiers.GeometryColor.ByGeometryColor(geometry=returnDynamoSolid_7, color=byARGB_5, lacing=Longest)
code_block_12 = CodeBlock { 0; 100; 200; 1100; }
byCoordinates_3 = Point.ByCoordinates(x=code_block_12.out3, y=code_block_12.out2, z=code_block_12.out0)
byCoordinates_4 = Point.ByCoordinates(x=code_block_12.out2, y=code_block_12.out3, z=code_block_12.out0)
byStartPointEndPoint_2 = Line.ByStartPointEndPoint(startPoint=byCoordinates_3, endPoint=byCoordinates_4)
code_block_13 = CodeBlock { 150; 500; }
revitAPIExtrusionFromCurve = GeometryAPI.SolidsAPI.RevitAPIExtrusionFromCurve(line=byStartPointEndPoint_2, width=code_block_13.out0, height=code_block_13.out1)
returnDynamoSolid_8 = GeometryAPI.SolidsAPI.ReturnDynamoSolid(solid=revitAPIExtrusionFromCurve)
code_block_14 = CodeBlock { 25; }
byARGB_6 = Color.ByARGB(alpha=code_block_14)
byGeometryColor_9 = Modifiers.GeometryColor.ByGeometryColor(geometry=returnDynamoSolid_8, color=byARGB_6, lacing=Longest)
select_the_room_in_the_host_file = DSModelElementByCategorySelection("OST_Rooms")  # 1 picked in the model
roomSurface = GeometryAPI.SurfacesAPI.RoomSurface(room=select_the_room_in_the_host_file)
code_block_15 = CodeBlock { 5; }
revitAPIExtrusionFromPlanarFace = GeometryAPI.SolidsAPI.RevitAPIExtrusionFromPlanarFace(face=roomSurface, height=code_block_15)
returnDynamoSolid_9 = GeometryAPI.SolidsAPI.ReturnDynamoSolid(solid=revitAPIExtrusionFromPlanarFace)
code_block_16 = CodeBlock { 25; }
byARGB_7 = Color.ByARGB(alpha=code_block_16)
byGeometryColor_10 = Modifiers.GeometryColor.ByGeometryColor(geometry=returnDynamoSolid_9, color=byARGB_7, lacing=Longest)
solidsUnion = GeometryAPI.BooleanAPI.SolidsUnion(solidsList=translateSolidVertically)
returnDynamoSolid_10 = GeometryAPI.SolidsAPI.ReturnDynamoSolid(solid=solidsUnion)
code_block_17 = CodeBlock { -2000; }
translate = Geometry.Translate(geometry=returnDynamoSolid_10, xTranslation=code_block_17)
code_block_18 = CodeBlock { 50; 255; }
byARGB_8 = Color.ByARGB(alpha=code_block_18.out0, red=code_block_18.out1)
byGeometryColor_11 = Modifiers.GeometryColor.ByGeometryColor(geometry=translate, color=byARGB_8, lacing=Longest)
solidsIntersection = GeometryAPI.BooleanAPI.SolidsIntersection(solidA=getAndUniteElementSolids, solidB=revitAPIExtrusionFromCurve)
watch_2 = Watch(solidsIntersection.intersectionVolume)
code_block_19 = CodeBlock { [500, 1000, 1500, 2000, 2500]; }
translateSolidVertically_2 = GeometryAPI.SolidsAPI.TranslateSolidVertically(solid=solidsIntersection.solidIntersection, translation=code_block_19, lacing=Longest)
returnDynamoSolid_11 = GeometryAPI.SolidsAPI.ReturnDynamoSolid(solid=translateSolidVertically_2)
code_block_20 = CodeBlock { 50; 255; }
byARGB_9 = Color.ByARGB(alpha=code_block_20.out0, green=code_block_20.out1)
byGeometryColor_12 = Modifiers.GeometryColor.ByGeometryColor(geometry=returnDynamoSolid_11, color=byARGB_9, lacing=Longest)
doSolidsIntersect = GeometryAPI.BooleanAPI.DoSolidsIntersect(solidA=getAndUniteElementSolids, solidB=revitAPIExtrusionFromCurve)
code_block_21 = CodeBlock()  # // NEEDS A FIX, OUTPUTS AN API SOLID, INSTEAD OF A BOOLEAN
list_create = List.Create(item0=getWallSolid, item1=flatten_2)
flatten_3 = List.Flatten(list=list_create)
code_block_22 = CodeBlock { 10; 300; }
roomFacesSolidIntersection = GeometryAPI.BooleanAPI.RoomFacesSolidIntersection(room=select_the_room_in_the_host_file, solids=flatten_3, baseOffset=code_block_22.out0, height=code_block_22.out1)
roomSurfaceIntersectionAreas = GeometryAPI.BooleanAPI.RoomSurfaceIntersectionAreas(room=select_the_room_in_the_host_file, solids=flatten_3, baseOffset=code_block_22.out0, height=code_block_22.out1)
getPhasesInChronologicalOrder = Inspect.DocumentData.GetPhasesInChronologicalOrder()
isCurveHorizontal = Inspect.GeometryData.IsCurveHorizontal(curve=byStartPointEndPoint)
returnLineStartPointEndPoint = Inspect.GeometryData.ReturnLineStartPointEndPoint(line=byStartPointEndPoint)
watch_3 = Watch(returnLineStartPointEndPoint.EndPoint)
watch_4 = Watch(returnLineStartPointEndPoint.StartPoint)
returnPointsCoordinates = Inspect.GeometryData.ReturnPointsCoordinates(point=watch_4)
watch_5 = Watch(returnPointsCoordinates.X)
watch_6 = Watch(returnPointsCoordinates.Y)
watch_7 = Watch(returnPointsCoordinates.Z)
coreBoundary = Room.CoreBoundary(room=select_the_room_in_the_host_file)
startPoint = Curve.StartPoint(curve=coreBoundary)
code_block_23 = CodeBlock { true; }
byPoints = PolyCurve.ByPoints(points=startPoint, connectLastToFirst=code_block_23)
byPatch = Surface.ByPatch(closedCurve=byPoints)
isSurfaceHorizontal = Inspect.GeometryData.IsSurfaceHorizontal(surface=byPatch)
